# Grasshopper definition 20201104_HerringBrick.gh (Grasshopper 1.0.7)

bricks = GhPythonScript()  # -> out, planes, meshes; inputs robot_base_geometry: list of Brep
# ---------- bricks: Python ----------
from compas_rhino import unload_modules
unload_modules('model')
from model import Brick
import Rhino.Geometry as rg
import math as m



def herring_bone(plane):
    planes = []
    meshes = []
    # first brick
    plane_origin = (plane.Origin + 
                    (plane.XAxis * Brick.REFERENCE_WIDTH/2) + 
                     (plane.YAxis *Brick.REFERENCE_LENGTH/2))
    brick_1_plane = rg.Plane(plane_origin, plane.XAxis, plane.YAxis)
    plane.Rotate(m.radians(90), rg.Vector3d.ZAxis)
    plane_rot = plane.Clone()
    brick_rot = Brick(plane_rot)
    planes.append(myBrick_rot.picking_plane())
    #meshes.append(myBrick_rot.mesh())
    
    # second brick
    plane_origin = (plane.Origin - 
                    (plane.XAxis * (Brick.REFERENCE_LENGTH/2 - Brick.REFERENCE_WIDTH/2)) 
                    - (plane.YAxis *((Brick.REFERENCE_LENGTH/2)+ Brick.REFERENCE_WIDTH/2)))
                    
    plane_brick_2 = rg.Plane(plane_origin, rg.Vector3d.XAxis, rg.Vector3d.YAxis)
    myBrick = Brick(plane_brick_2)
    planes.append(myBrick.picking_plane())
    #meshes.append(myBrick.mesh())
    return meshes



test_plane = rg.Plane(rg.Point3d(0,0,0), rg.Vector3d.XAxis, rg.Vector3d.YAxis)

herring_bone(test_plane)
meshes = []
for i in range (1):
    brick_plane = rg.Plane(rg.Point3d(Brick.REFERENCE_WIDTH*i,Brick.REFERENCE_WIDTH*i,100), rg.Vector3d.XAxis, rg.Vector3d.YAxis)
    meshes.extend(herring_bone(brick_plane))
# ---------- end bricks ----------
python = GhPythonScript()  # -> out, planes, meshes
# ---------- python: Python ----------
from compas_rhino import unload_modules
unload_modules('model')

from model import Brick
import Rhino.Geometry as rg
import math

def herring_Brick(plane):
    planes = []
    planes_base =[]
    
    # first brick
    plane_origin = (plane.Origin
                   +(plane.XAxis * Brick.REFERENCE_WIDTH/2)
                   +(plane.YAxis * Brick.REFERENCE_LENGTH/2))
    
    brick_1_plane = rg.Plane(plane_origin, plane.XAxis, plane.YAxis)
    brick_1_plane.Rotate(math.radians(90), rg.Vector3d.ZAxis)
    planes_base.append(brick_1_plane)
    plane_rot = brick_1_plane.Clone()
    brick_rot = Brick(plane_rot)
    planes.append(brick_rot.picking_plane())
    
    # second brick
    plane_2_origin = (plane.Origin 
                   +(plane.XAxis * Brick.REFERENCE_LENGTH)
                   +(plane.YAxis * Brick.REFERENCE_WIDTH/2))
    
    brick_2_plane = rg.Plane(plane_2_origin, plane.XAxis, plane.YAxis)
    brick_2_plane.Rotate(math.radians(0), rg.Vector3d.ZAxis)
    planes_base.append(brick_2_plane)
    plane_2_rot = brick_2_plane.Clone()
    brick_2_rot = Brick(plane_2_rot)
    planes.append(brick_2_rot.picking_plane())
    
    # third brick
    plane_3_origin = (plane.Origin 
                   -(plane.XAxis)
                   +(plane.YAxis 
                     *(Brick.REFERENCE_LENGTH + Brick.REFERENCE_WIDTH/2 )))
    
    brick_3_plane = rg.Plane(plane_3_origin, plane.XAxis, plane.YAxis)
    brick_3_plane.Rotate(math.radians(0), rg.Vector3d.ZAxis)
    planes_base.append(brick_3_plane)
    plane_3_rot = brick_3_plane.Clone()
    brick_3_rot = Brick(plane_3_rot)
    planes.append(brick_3_rot.picking_plane())
    
    return planes, planes_base

meshes =[]
planes = []
planes_base = []

for i in range(5):
    # plan gap
    gap_h = Brick.REFERENCE_WIDTH
    # vertcal gap
    gap_v = Brick.REFERENCE_HEIGHT
    
    brick_plane = rg.Plane(rg.Point3d(gap_h * i, gap_h* i, 0),
                            rg.Vector3d.XAxis, 
                            rg.Vector3d.YAxis)
    planes.extend(herring_Brick(brick_plane)[0])
    planes_base.extend(herring_Brick(brick_plane)[1])
for plane in planes_base:
    b = Brick(plane)
    meshes.append(b.mesh())
# ---------- end python ----------
python_2 = GhPythonScript(row=Slider(5, range=0..10))  # -> out, planes, meshes_h, meshes_v; inputs row: Int32
# ---------- python_2: Python ----------
from compas_rhino import unload_modules
unload_modules('model')

import Rhino.Geometry as rg
from model import Brick
import math

def herring_bone(plane, row):
    planes = []
    meshes = []
    
    
    
    
    
    
    
    


def brick_horizontal_laying(row, gap):
    planes = []
    meshes = []
    x = Brick.REFERENCE_LENGTH / 2 
    y = Brick.REFERENCE_WIDTH + 1 
    
    for i in range(row):
        x_value = x * i + Brick.REFERENCE_LENGTH
        y_value = y * i + Brick.REFERENCE_WIDTH/2
        plane_origin = rg.Point3d(x_value, y_value, 0)
        plane = rg.Plane(plane_origin, rg.Vector3d.XAxis, rg.Vector3d.YAxis)
        planes.append(plane)
        b = Brick(plane)
        meshes.append(b.mesh())
    return planes, meshes


def brick_Vertical_laying(row, gap):
    planes = []
    meshes = []
    x = Brick.REFERENCE_LENGTH / 2 
    y = Brick.REFERENCE_WIDTH + 1 
    strat_vaule_x = Brick.REFERENCE_WIDTH/2 + 1 
    strat_vaule_y = Brick.REFERENCE_WIDTH/2 + Brick.REFERENCE_LENGTH / 2 + 1
    
    for i in range(row):
        x_value = x * i + Brick.REFERENCE_WIDTH/2
        y_value = y * i + Brick.REFERENCE_LENGTH / 2
        plane_origin = rg.Point3d(x_value, y_value, 0)
        plane = rg.Plane(plane_origin, rg.Vector3d.XAxis, rg.Vector3d.YAxis)
        plane.Rotate(math.radians(90), rg.Vector3d.ZAxis)
        planes.append(plane)
        b = Brick(plane)
        meshes.append(b.mesh())
    return planes, meshes



planes, meshes_h = brick_horizontal_laying(row,0.5)
planes02, meshes_v = brick_Vertical_laying(row,0.5)
# ---------- end python_2 ----------
geo = Geometry(python.meshes)
geo_2 = Geometry(bricks.meshes)
