# Grasshopper definition Herring_brick_fabrication_comb.ghx (Grasshopper 1.0.7)
# plug-ins: MeshEdit Components

# ---- group: Oriented plan
panel = Panel("""{299, 63, 0}
{499, 63, 0}
{499, 299, 0}""")
# Create Bricks
number_slider = Slider(20, range=0..100)
pt = Point(panel)
pline = PolyLine(Vertices=pt, Closed=False)
points = PointList(Points=pt, Size=number_slider)

# ----
# Main Program
robotmodel = Geometry([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])

# ---- group: Rotate Degree
division = Division(A="180", B=Slider(30, range=0..100))
panel_2 = Panel(division)

# ----
number_slider_2 = Slider(40, range=0..100)  # disabled

# ---- group: 20201110 / Rotate Degree
number_slider_3 = Slider(30, range=0..100)  # disabled
panel_3 = Panel("180")  # disabled
division_2 = Division(A=panel_3, B=number_slider_3)  # disabled
panel_4 = Panel(division_2)  # disabled

# ----
number_slider_4 = Slider(5, range=0..100)  # disabled
panel_5 = Panel("180")  # disabled
rotate_center = Point(Point(-0.03039079075, -0.003853279266, 0))
# Roate decrease number of brick by Rules
number_slider_5 = Slider(100, range=0..100)
division_3 = Division(A=panel_5, B=number_slider_2)  # disabled
panel_6 = Panel(division_3)  # disabled

# ---- group: HerringBrcik
python = GhPythonScript(plan_depth=Slider(5, range=0..100), height=Slider(40, range=0..100), angle=division, center_point=rotate_center)  # -> out, substract_planes, substract_planes_base, meshes, substract_meshes; inputs plan_depth: Int32, height: Int32, center_point: Point3d
# ---------- python: Python ----------
from compas_rhino import unload_modules
unload_modules('model')
from model import Brick
import Rhino.Geometry as rg
import math
# import compas_ghpython


def herring_bone(plan_depth ,x_postion ,y_postion, z_postion, angle):
    """
    ### this funtion is plane for herring bone
    
    x_postion is brick X coordinate
    y_postion is brick Y coordinate
    z_postion is brick z coordinate
    angle is brick place direction
    
    """
    planes = [] # Top plane for robot picking up
    planes_base = [] # base plane for create visual brick
    # horizontal gap
    gap_hori = Brick.REFERENCE_WIDTH +2.5
    for i in range(plan_depth):
        x_value = gap_hori * i + x_postion
        y_value = gap_hori * i + y_postion
        z_value = z_postion
        
        # create brick plane
        plane_origin = rg.Point3d(x_value, y_value, z_value)
        brick_plane = rg.Plane(plane_origin, rg.Vector3d.XAxis, rg.Vector3d.YAxis)
        brick_plane.Rotate(math.radians(angle), rg.Vector3d.ZAxis)
        planes_base.append(brick_plane)
        plane_rot = brick_plane.Clone()
        brick_rot = Brick(plane_rot)
        planes.append(brick_rot.picking_plane())
    return planes, planes_base


# rotate plane 
def rotateBycentre(planes, angle, center_point):
    center_point = c_p # rotate centre
    plane_rot =[] 
    for p in planes:
        T = rg.Transform.Rotation(math.radians(angle), c_p)
        p.Transform(T)
        plane_rot.append(p)
    return plane_rot

#####          #####
##### RUN CODE #####
#####          #####

# define the x_postion and y_postion for bricks
## modify brick gap here
b_leng = Brick.REFERENCE_LENGTH
b_wid = Brick.REFERENCE_WIDTH

x_p_R1, y_p_R1 = b_leng +0.8, b_wid/2
x_p_R2, y_p_R2 = b_wid/2, b_leng/2
x_p_L1, y_p_L1 = -.5, b_leng + b_wid/2 +1.3
x_p_L2, y_p_L2 = -1*(b_leng/2 + b_wid/2 + 1.8), b_leng + b_wid +1.8

##########
planes = []
planes_base = []

# stacking
for i in range(height):
    b_h = Brick.REFERENCE_HEIGHT 
    # create pattern by remove last brick 
    if i % 2 == 0:
    # create plane
        planes_r1, planes_base_r1 = herring_bone(plan_depth, x_p_R1, y_p_R1, b_h *i, 0)
        planes_r2, planes_base_r2 = herring_bone(plan_depth, x_p_R2, y_p_R2, b_h *i, 90)
        planes_r3, planes_base_r3 = herring_bone(plan_depth, x_p_L1, y_p_L1, b_h *i, 0)
        planes_r4, planes_base_r4 = herring_bone(plan_depth, x_p_L2, y_p_L2, b_h *i, 90)
        
        planes.append(planes_r1
                    + planes_r2 
                    + planes_r3
                    + planes_r4)
                    
        planes_base.append(planes_base_r1
                        + planes_base_r2
                        + planes_base_r3
                        + planes_base_r4)
    else:
        planes_r1, planes_base_r1 = herring_bone(plan_depth, x_p_R1, y_p_R1, b_h *i, 90)
        planes_r2, planes_base_r2 = herring_bone(plan_depth, x_p_R2, y_p_R2, b_h *i, 0)
        planes_r3, planes_base_r3 = herring_bone(plan_depth, x_p_L1, y_p_L1, b_h *i, 90)
        planes_r4, planes_base_r4 = herring_bone(plan_depth, x_p_L2, y_p_L2, b_h *i, 0)
        
        planes.append(planes_r1
                    + planes_r2 
                    + planes_r3
                    + planes_r4)
        planes_base.append(planes_base_r1
                        + planes_base_r2
                        + planes_base_r3
                        + planes_base_r4)


####### roatate by layers
c_p = center_point
planes_base_rot = []
planes_rot = []

# divide layers
"""
number of layers is the same as height
"""
lenLayers = height
f_set = int(lenLayers/4) #first_set
s_set = f_set+10 #second_set

for i, p in enumerate(planes):
    if i <=f_set:
        planes_rot.append(rotateBycentre(p, angle*i, c_p))
    elif i>f_set and i<s_set:
        planes_rot.append(rotateBycentre(p, angle*f_set-angle*(i-f_set), c_p))
    else:
        planes_rot.append(rotateBycentre(p, angle*f_set-angle*(s_set-f_set)+angle*(i-s_set), c_p))
        
for i, p in enumerate(planes_base):
    if i <=f_set:
        planes_base_rot.append(rotateBycentre(p, angle*i, c_p))
    elif i>f_set and i<s_set:
        planes_base_rot.append(rotateBycentre(p, angle*f_set-angle*(i-f_set), c_p))
    else:
        planes_base_rot.append(rotateBycentre(p, angle*f_set-angle*(s_set-f_set)+angle*(i-s_set), c_p))


######## substraction
# each layer has 4*plandepth brciks

substract_planes =[]
substract_planes_base =[]

print(f_set)
for i in range(height):
    for j in range(20):
        if (i>1 and i<f_set and i%2 == 0) and j< 4:
            pass
        elif (i>=f_set and i<s_set+1 and j== 11) or (i>=4 and i<s_set+10 and j== 10):
            pass
        elif (i>=s_set+7 and j%5 ==4):
            pass
        elif (i>=s_set+10 and j%5 ==3):
            pass
        elif (i>=s_set+13 and j%5 ==2):
            pass
        else:
            substract_planes.append(planes_base_rot[i][j])

for i in range(height):
    for j in range(20):
        if (i>1 and i<f_set and i%2 == 0) and j< 4:
            pass
        elif (i>=f_set and i<s_set+1 and j== 11) or (i>=4 and i<s_set+10 and j== 10):
            pass
        elif (i>=s_set+7 and j%5 ==4):
            pass
        elif (i>=s_set+10 and j%5 ==3):
            pass
        elif (i>=s_set+13 and j%5 ==2):
            pass
        else:
            substract_planes_base.append(planes_base_rot[i][j])



# all meshes
meshes =[]
for plane in planes_base_rot:
    for p in plane:
        b = Brick(p)
        meshes.append(b.mesh())
        
substract_meshes =[]
for plane in substract_planes_base:
    b = Brick(plane)
    substract_meshes.append(b.mesh())
# ---------- end python ----------

# ----
rotate_center_2 = Point(Point(-0.03039079075, -0.003853279266, 0))  # disabled

# ---- group: HerringBrcik
python_2 = GhPythonScript(plan_depth=number_slider_4, height=number_slider_4, angle_vetical=division_3, center_point=rotate_center_2)  # -> out, planes, planes_base, meshes, brick_pairs; inputs plan_depth: Int32, height: Int32, center_point: Point3d; disabled
# ---------- python_2: Python ----------
from compas_rhino import unload_modules
unload_modules('model')
from model import Brick
import Rhino.Geometry as rg
import math
# import compas_ghpython

### this funtion is plane for herring bone
def herring_bone(plan_depth ,x_postion ,y_postion, z_postion, angle):
    """
    x_postion is brick X coordinate
    y_postion is brick Y coordinate
    z_postion is brick z coordinate
    angle is brick place direction
    """
    planes = [] # Top plane for robot picking up
    planes_base = [] # base plane for create visual brick
    
    bricks = []
    
    # horizontal gap
    gap_hori = Brick.REFERENCE_WIDTH +2.5
    for i in range(plan_depth):
        x_value = gap_hori * i + x_postion
        y_value = gap_hori * i + y_postion
        z_value = z_postion
        
        # create brick plane
        plane_origin = rg.Point3d(x_value, y_value, z_value)
        brick_plane = rg.Plane(plane_origin, rg.Vector3d.XAxis, rg.Vector3d.YAxis)
        brick_plane.Rotate(math.radians(angle), rg.Vector3d.ZAxis)
        planes_base.append(brick_plane)
        plane_rot = brick_plane.Clone()
        brick_rot = Brick(plane_rot)
        bricks.append(brick_rot)
        planes.append(brick_rot.picking_plane())
        
    return planes, planes_base


# rotate plane 
def rotateBycentre(planes, angle, center_point):
    center_point = c_p # rotate centre
    plane_rot =[] 
    for p in planes:
        T = rg.Transform.Rotation(angle, c_p)
        p.Transform(T)
        plane_rot.append(p)
    return plane_rot

#####          #####
##### RUN CODE #####
#####          #####

# define the x_postion and y_postion for bricks
## modify brick gap here
b_leng = Brick.REFERENCE_LENGTH
b_wid = Brick.REFERENCE_WIDTH

x_p_R1, y_p_R1 = b_leng +0.8, b_wid/2
x_p_R2, y_p_R2 = b_wid/2, b_leng/2
x_p_L1, y_p_L1 = -.5, b_leng + b_wid/2 +1.3
x_p_L2, y_p_L2 = -1*(b_leng/2 + b_wid/2 + 1.8), b_leng + b_wid +1.8

##########
meshes =[]
planes = []
planes_base = []


### I think the way_you append the lists are the problem ###
plane_lists_1 = []
plane_lists_2 = []
plane_lists_3 = []
plane_lists_4 = []
# stacking
for i in range(height):
    b_h = Brick.REFERENCE_HEIGHT 
    c_p = center_point # rotate centre
    angle = math.radians(angle_vetical)
    # create plane
    planes_r1, planes_base_r1 = herring_bone(plan_depth, x_p_R1, y_p_R1, b_h *i, 0)
    planes_r2, planes_base_r2 = herring_bone(plan_depth, x_p_R2, y_p_R2, b_h *i, 90)
    planes_r3, planes_base_r3 = herring_bone(plan_depth, x_p_L1, y_p_L1, b_h *i, 0)
    planes_r4, planes_base_r4 = herring_bone(plan_depth, x_p_L2, y_p_L2, b_h *i, 90)
    # create pattern by remove last brick 
    if i == 0:
        planes.append(planes_r1
                    + planes_r2 
                    + planes_r3
                    + planes_r4)
                    
        planes_base.append(planes_base_r1
                        + planes_base_r2
                        + planes_base_r3
                        + planes_base_r4)
                        
    else:
        planes.append(planes_r1
                    + planes_r2 
                    + planes_r3
                    + planes_r4)
                    
                    
        planes_base.append(planes_base_r1[0:(plan_depth-i)]
                        + planes_base_r2
                        + planes_base_r3
                        + planes_base_r4[0:(plan_depth-i)])
        
        plane_lists_1.append(planes_base_r1[0:(plan_depth-i+1)])
        plane_lists_2.append(planes_base_r2)
        plane_lists_3.append(planes_base_r3)
        plane_lists_4.append(planes_base_r4[0:(plan_depth-i+1)])
    #############
    # reverse rotate plane
    
for i, p in enumerate (planes_base):
    rotateBycentre(p, angle*i, c_p)
#        rotateBycentre(planes_r1, angle*i, c_p)
#        rotateBycentre(planes_r2, angle*i, c_p)
#        rotateBycentre(planes_r3, angle*i, c_p)
#        rotateBycentre(planes_r4, angle*i, c_p)
#        
#        rotateBycentre(planes_base_r1, angle*i, c_p)
#        rotateBycentre(planes_base_r2, angle*i, c_p)
#        rotateBycentre(planes_base_r3, angle*i, c_p)
#        rotateBycentre(planes_base_r4, angle*i, c_p)   

# all meshes
#meshes =[]
for plane in planes_base:
    for p in plane:
        b = Brick(p)
        meshes.append(b.mesh())



### the first 
# meshes pair
mesh =[]

b1 = Brick(plane_lists_1[0][0])
b2 = Brick(plane_lists_1[0+1][0]) 

mesh.append(b1.mesh())
mesh.append(b2.mesh())



### how to join bricks in pairs in a loop:
#brick_pairs = []
#print len(plane_lists_1)
#
#for j in range(len(plane_lists_1)):             # this is the bricks in height 
#    for i in range(len(plane_lists_1[j])):       # this is each brick per layer    
#        if i !=0:                               # first brick we do not check-it is on the ground
#            brick_1 =  plane_lists_1[i-1][j]    # the brick under 
#            b_1 = Brick(brick_1)
#            mesh_1 = b_1.mesh()
#            
#            brick_2 =  plane_lists_1[i][j]      # the brick on top
#            b_2 = Brick(brick_2)
#            mesh_2 = b_2.mesh()
#            
#            brick_pairs.append([mesh_1, mesh_2])
# ---------- end python_2 ----------

# ----
Y = UnitY(Factor=number_slider_5)
move = Move(Geometry=pline, Motion=Y)  # -> Geometry, Transform
number_slider_6 = Slider(0, range=0..10)  # disabled
explode = Explode(Curve=move.Geometry, Recursive=True)  # -> Segments, Vertices
plane_for_visualization = Plane(flatten(python.substract_planes_base))
planetorobot = Plane(flatten(python.substract_planes))
python_3 = GhPythonScript(brick_pairs=python_2.brick_pairs, index=number_slider_6)  # -> out, brick_pair; inputs brick_pairs: list, index: Int32; disabled
# ---------- python_3: Python ----------
brick_pair = brick_pairs[index]
# ---------- end python_3 ----------
avr = Average(Input=explode.Vertices)
panel_7 = Panel(explode.Vertices)
bricks = Mesh(python.substract_meshes)
geo = Geometry(python_2.meshes)  # disabled
mesh = Mesh(python.meshes)
geo_2 = Geometry(python_2.meshes)  # disabled
geo_3 = Geometry(python_3.brick_pair)  # disabled
explode_2 = MeshExplode(Mesh=geo_3, Interpolate=False)  # disabled
panel_8 = Panel("""1
6""")  # disabled
item = ListItem(List=explode_2, Index=graft(panel_8), Wrap=True)  # -> simplify(Item); disabled
geo_4 = Geometry(planetorobot)
number_slider_7 = Slider(40, range=0..100)  # disabled
demesh = DeconstructMesh(Mesh=item)  # -> Vertices, Faces, Colours, Normals; disabled
panel_9 = Panel("180")  # disabled
pline_2 = PolyLine(Vertices=demesh.Vertices, Closed=invert(False))  # disabled
division_4 = Division(A=panel_9, B=number_slider_7)  # disabled
number_slider_8 = Slider(5, range=0..100)  # disabled
number_slider_9 = Slider(3, range=0..100)  # disabled
item_2 = ListItem(List=flatten(pline_2), Index=0, Wrap=True)  # -> Item, Item1; disabled
rotation_of_each_layer = Panel(division_4)  # disabled
rotate_center_3 = Point(Point(-0.03039079075, -0.003853279266, 0))  # disabled
rint = RegionIntersection(CurvesA=item_2.Item, CurvesB=item_2.Item1)  # disabled

# ---- group: min_touch_area
python_4 = GhPythonScript()  # -> out, min_touch_area; disabled
# ---------- python_4: Python ----------
from compas_rhino import unload_modules
unload_modules('model')
from model import Brick
import Rhino.Geometry as rg

min_tough_area = Brick.REFERENCE_LENGTH * Brick.REFERENCE_WIDTH/3
# ---------- end python_4 ----------

# ---- group: HerringBrcik
python_5 = GhPythonScript(plan_depth=number_slider_8, height=number_slider_9, angle_vetical=division_4, center_point=rotate_center_3)  # -> out, planes, planes_base, meshes; inputs plan_depth: Int32, height: Int32, center_point: Point3d; disabled
# ---------- python_5: Python ----------
from compas_rhino import unload_modules
unload_modules('model')
from model import Brick
import Rhino.Geometry as rg
import math

### this funtion is plane for herring bone
def herring_bone(plan_depth ,x_postion ,y_postion, z_postion, angle):
    """
    x_postion is brick X coordinate
    y_postion is brick Y coordinate
    z_postion is brick z coordinate
    angle is brick place direction
    """
    planes = [] # Top plane for robot picking up
    planes_base = [] # base plane for create visual brick
    # horizontal gap
    gap_hori = Brick.REFERENCE_WIDTH +2.5
    for i in range(plan_depth):
        x_value = gap_hori * i + x_postion
        y_value = gap_hori * i + y_postion
        z_value = z_postion
        
        # create brick plane
        plane_origin = rg.Point3d(x_value, y_value, z_value)
        brick_plane = rg.Plane(plane_origin, rg.Vector3d.XAxis, rg.Vector3d.YAxis)
        brick_plane.Rotate(math.radians(angle), rg.Vector3d.ZAxis)
        planes_base.append(brick_plane)
        plane_rot = brick_plane.Clone()
        brick_rot = Brick(plane_rot)
        planes.append(brick_rot.picking_plane())
    return planes, planes_base


# rotate plane 
def rotateBycentre(planes, angle, center_point):
    center_point = c_p # rotate centre
    plane_rot =[] 
    for p in planes:
        T = rg.Transform.Rotation(angle, c_p)
        p.Transform(T)
        plane_rot.append(p)
    return plane_rot

#####          #####
##### RUN CODE #####
#####          #####

# define the x_postion and y_postion for bricks
## modify brick gap here
b_leng = Brick.REFERENCE_LENGTH
b_wid = Brick.REFERENCE_WIDTH

x_p_R1, y_p_R1 = b_leng +0.8, b_wid/2
x_p_R2, y_p_R2 = b_wid/2, b_leng/2
x_p_L1, y_p_L1 = -.5, b_leng + b_wid/2 +1.3
x_p_L2, y_p_L2 = -1*(b_leng/2 + b_wid/2 + 1.8), b_leng + b_wid +1.8

##########
meshes =[]
planes = []
planes_base = []

# stacking
for i in range(height):
    b_h = Brick.REFERENCE_HEIGHT 
    c_p = center_point # rotate centre
    angle = math.radians(angle_vetical)
    
    # create pattern by remove last brick 
    if i % 2 ==0:
        # create plane
        planes_r1, planes_base_r1 = herring_bone(plan_depth, x_p_R1, y_p_R1, b_h *i, 0)
        planes_r2, planes_base_r2 = herring_bone(plan_depth, x_p_R2, y_p_R2, b_h *i, 90)
        planes_r3, planes_base_r3 = herring_bone(plan_depth, x_p_L1, y_p_L1, b_h *i, 0)
        planes_r4, planes_base_r4 = herring_bone(plan_depth, x_p_L2, y_p_L2, b_h *i, 90)
        planes.append(planes_r1
                    + planes_r2 
                    + planes_r3
                    + planes_r4)
                    
        planes_base.append(planes_base_r1
                        + planes_base_r2
                        + planes_base_r3
                        + planes_base_r4)
    elif i % 2 ==1:
        planes_r1, planes_base_r1 = herring_bone(plan_depth, x_p_R1, y_p_R1, b_h *i, 90)
        planes_r2, planes_base_r2 = herring_bone(plan_depth, x_p_R2, y_p_R2, b_h *i, 0)
        planes_r3, planes_base_r3 = herring_bone(plan_depth, x_p_L1, y_p_L1, b_h *i, 90)
        planes_r4, planes_base_r4 = herring_bone(plan_depth, x_p_L2, y_p_L2, b_h *i, 0)
        planes.append(planes_r1
                    + planes_r2 
                    + planes_r3
                    + planes_r4)
        planes_base.append(planes_base_r1
                        + planes_base_r2
                        + planes_base_r3
                        + planes_base_r4)
    #############
    rotateBycentre(planes_r1, angle*i, c_p)
    rotateBycentre(planes_r2, angle*i, c_p)
    rotateBycentre(planes_r3, angle*i, c_p)
    rotateBycentre(planes_r4, angle*i, c_p)
    
    rotateBycentre(planes_base_r1, angle*i, c_p)
    rotateBycentre(planes_base_r2, angle*i, c_p)
    rotateBycentre(planes_base_r3, angle*i, c_p)
    rotateBycentre(planes_base_r4, angle*i, c_p)
########


# all meshes
#meshes =[]
for plane in planes_base:
    for p in plane:
        b = Brick(p)
        meshes.append(b.mesh())
# ---------- end python_5 ----------

# ----
area = Area(Geometry=rint)  # -> Area, Centroid; disabled
smaller = SmallerThan(FirstNumber=area.Area, SecondNumber=python_4.min_touch_area)  # -> SmallerThan, OrEqualTo; disabled
cull = CullPattern(List=geo_3, CullPattern=invert(smaller.SmallerThan))  # disabled
panel_10 = Panel(smaller.SmallerThan)  # disabled

# ---- group: planes
unpack = GhPythonScript(Tree=python_5.planes)  # -> simplify(Upackdata); disabled
# ---------- unpack: Python ----------
### unpack IRONPYTHON
Upackdata = Tree
# ---------- end unpack ----------

# ---- group: planes_base
unpack_2 = GhPythonScript(Tree=python_5.planes_base)  # -> simplify(Upackdata); disabled; same code as unpack

# ---- group: selectpath
number_slider_10 = Slider(0, range=0..4)

# ----
geo_5 = Geometry(cull)  # disabled
unflatten = UnflattenTree(Tree=python_5.meshes, Guide=unpack_2)  # disabled
series = Series(Start=0, Step=1, Count=Slider(36, range=0..100))
list = ValueList({"Test": 0, "All model": 1}, selected="Test")
plane_for_visualization_2 = Plane(flatten(plane_for_visualization))
bricks_2 = Mesh(bricks)

# ----
# Visualization
python_6 = GhPythonScript(Base_plane=plane_for_visualization_2)  # -> out, bricks; inputs Base_plane: list
# ---------- python_6: Python ----------
import rhinoscriptsyntax as rs
import Rhino.Geometry as rg
import ghpythonlib.components as gh

from model import Brick

def set_robot_base_plane_from_pts():
    pt_0 = rg.Point3d(299, 63, -0)  # base plane origin
    # point on base plane positive x direction
    pt_1 = rg.Point3d(499, 63, 0)
    pt_2 = rg.Point3d(499, 299, 0)  # point on base plane positive xy

    robot_base = rg.Plane(pt_0, pt_1-pt_0, pt_2-pt_0)
    return robot_base

def rhino_to_robot_space(rhino_plane):
    """ this funktion translates planes from the rhino cordinate system to
    the robot cordinate system 
    """
    robot_plane = rhino_plane.Clone()
    _r_matrix = rg.Transform.PlaneToPlane(rg.Plane.WorldXY, set_robot_base_plane_from_pts())
    robot_plane.Transform(_r_matrix)
    return robot_plane

###          ### 
### Run Code ###
###          ###
bricks = []
for plane in Base_plane:
    planes = rhino_to_robot_space(plane)
    b = Brick(planes)
    bricks.append(b.mesh())
# ---------- end python_6 ----------

# ---- group: Total Counts
lng = ListLength(List=flatten(bricks_2))
panel_11 = Panel(lng)

# ---- group: SEND TO ROBOT
button = Button()

# ---- group: Robot_ enviroment
preview = CustomPreview(Geometry=robotmodel, Material=ColourSwatch(SwatchColor=RGBA(255, 255, 255, 46)))

# ----
number_slider_11 = Slider(10, range=0..10)

# ---- group: 20201110
number_slider_12 = Slider(5, range=0..100)  # disabled
number_slider_13 = Slider(30, range=0..100)  # disabled
rotate_center_4 = Point(Point(-0.03039079075, -0.003853279266, 0))  # disabled

# ---- group: 20201110 / HerringBrcik
python_7 = GhPythonScript(plan_depth=number_slider_12, height=number_slider_13, angle=division_2, center_point=rotate_center_4)  # -> out, planes, planes_base, meshes, planes_rot, planes_base_rot; inputs plan_depth: Int32, height: Int32, center_point: Point3d; disabled
# ---------- python_7: Python ----------
from compas_rhino import unload_modules
unload_modules('model')
from model import Brick
import Rhino.Geometry as rg
import math

def herring_bone(plan_depth ,x_postion ,y_postion, z_postion, angle):
    """
    ### this funtion is plane for herring bone
    
    x_postion is brick X coordinate
    y_postion is brick Y coordinate
    z_postion is brick z coordinate
    angle is brick place direction
    
    """
    planes = [] # Top plane for robot picking up
    planes_base = [] # base plane for create visual brick
    # horizontal gap
    gap_hori = Brick.REFERENCE_WIDTH +2.5
    for i in range(plan_depth):
        x_value = gap_hori * i + x_postion
        y_value = gap_hori * i + y_postion
        z_value = z_postion
        
        # create brick plane
        plane_origin = rg.Point3d(x_value, y_value, z_value)
        brick_plane = rg.Plane(plane_origin, rg.Vector3d.XAxis, rg.Vector3d.YAxis)
        brick_plane.Rotate(math.radians(angle), rg.Vector3d.ZAxis)
        planes_base.append(brick_plane)
        plane_rot = brick_plane.Clone()
        brick_rot = Brick(plane_rot)
        planes.append(brick_rot.picking_plane())
    return planes, planes_base


# rotate plane 
def rotateBycentre(planes, angle, center_point):
    center_point = c_p # rotate centre
    plane_rot =[] 
    for p in planes:
        T = rg.Transform.Rotation(math.radians(angle), c_p)
        p.Transform(T)
        plane_rot.append(p)
    return plane_rot

#####          #####
##### RUN CODE #####
#####          #####

# define the x_postion and y_postion for bricks
## modify brick gap here
b_leng = Brick.REFERENCE_LENGTH
b_wid = Brick.REFERENCE_WIDTH

x_p_R1, y_p_R1 = b_leng +0.8, b_wid/2
x_p_R2, y_p_R2 = b_wid/2, b_leng/2
x_p_L1, y_p_L1 = -.5, b_leng + b_wid/2 +1.3
x_p_L2, y_p_L2 = -1*(b_leng/2 + b_wid/2 + 1.8), b_leng + b_wid +1.8

##########
meshes =[]
planes = []
planes_base = []

# stacking
for i in range(height):
    b_h = Brick.REFERENCE_HEIGHT 
    # create pattern by remove last brick 
    if i % 2 == 0:
    # create plane
        planes_r1, planes_base_r1 = herring_bone(plan_depth, x_p_R1, y_p_R1, b_h *i, 0)
        planes_r2, planes_base_r2 = herring_bone(plan_depth, x_p_R2, y_p_R2, b_h *i, 90)
        planes_r3, planes_base_r3 = herring_bone(plan_depth, x_p_L1, y_p_L1, b_h *i, 0)
        planes_r4, planes_base_r4 = herring_bone(plan_depth, x_p_L2, y_p_L2, b_h *i, 90)
        
        planes.append(planes_r1
                    + planes_r2 
                    + planes_r3
                    + planes_r4)
                    
        planes_base.append(planes_base_r1
                        + planes_base_r2
                        + planes_base_r3
                        + planes_base_r4)
    else:
        planes_r1, planes_base_r1 = herring_bone(plan_depth, x_p_R1, y_p_R1, b_h *i, 90)
        planes_r2, planes_base_r2 = herring_bone(plan_depth, x_p_R2, y_p_R2, b_h *i, 0)
        planes_r3, planes_base_r3 = herring_bone(plan_depth, x_p_L1, y_p_L1, b_h *i, 90)
        planes_r4, planes_base_r4 = herring_bone(plan_depth, x_p_L2, y_p_L2, b_h *i, 0)
        
        planes.append(planes_r1
                    + planes_r2 
                    + planes_r3
                    + planes_r4)
        planes_base.append(planes_base_r1
                        + planes_base_r2
                        + planes_base_r3
                        + planes_base_r4)

# roatate by layers
c_p = center_point
planes_base_rot = []
planes_rot = []
# divide layers
"""
number of layers is the same as height

"""
lenLayers = height
f_set = int(height/2) #first_set
s_set = f_set+5 #second_set

for i, p in enumerate(planes):
    if i <f_set:
        planes_rot.append(rotateBycentre(p, angle*i, c_p))
    elif i>f_set and i<s_set:
        planes_rot.append(rotateBycentre(p, angle*f_set-angle*(i-f_set), c_p))
    else:
        planes_rot.append(rotateBycentre(p, angle*f_set-angle*(s_set-f_set)+angle*(i-s_set), c_p))

for i, p in enumerate(planes_base):
    if i <=f_set:
        planes_base_rot.append(rotateBycentre(p, angle*i, c_p))
    elif i>f_set and i<s_set:
        planes_base_rot.append(rotateBycentre(p, angle*f_set-angle*(i-f_set), c_p))
    else:
        planes_base_rot.append(rotateBycentre(p, angle*f_set-angle*(s_set-f_set)+angle*(i-s_set), c_p))

# all meshes
#meshes =[]
for plane in planes_base_rot:
    for p in plane:
        b = Brick(p)
        meshes.append(b.mesh())
# ---------- end python_7 ----------

# ---- group: 20201110 / planes_rot
unpack_3 = GhPythonScript(Tree=python_7.planes_rot)  # -> simplify(Upackdata); disabled; same code as unpack

# ---- group: 20201110 / planes_base_rot
unpack_4 = GhPythonScript(Tree=python_7.planes_base_rot)  # -> simplify(Upackdata); disabled; same code as unpack

# ---- group: 20201110 (continued)
unflatten_2 = UnflattenTree(Tree=python_7.meshes, Guide=unpack_4)  # disabled

# ---- group: sperate the number of planes to fabrication
lng_2 = ListLength(List=geo_4)
multiplication = Multiplication(A=Slider(6, range=0..10), B=Slider(10, range=0..10), C=Slider(2, range=0..10))

# ---- group: sperate the number of planes to fabrication / mod_and_divid
python_8 = GhPythonScript(x=lng_2, y=multiplication)  # -> out, a
# ---------- python_8: Python ----------
while (x>y):
    x=x-y
    print(y)
else:
    a =x
# ---------- end python_8 ----------

# ---- group: sperate the number of planes to fabrication (continued)
merge = Merge(Data1=flatten(python_8.out), Data2=flatten(python_8.a))
ma = MassAddition(Input=merge)  # -> Result, PartialResults
shift = ShiftList(List=ma.PartialResults, Shift=-1, Wrap=invert(True))
merge_2 = Merge(Data1="0", Data2=shift)  # -> flatten(Result)
series_2 = Series(Start=merge_2, Step=1, Count=merge)
tstat = TreeStatistics(Tree=series_2)  # -> Paths, Length, Count
panel_12 = Panel(tstat.Count)

# ---- group: sperate the number of planes to fabrication / check not out of path
python_9 = GhPythonScript(x=number_slider_10, y=tstat.Count)  # -> out, a
# ---------- python_9: Python ----------
if x <= y-1:
    print(int(x))
else:
    print(int(y-1))
# ---------- end python_9 ----------

# ---- group: sperate the number of planes to fabrication (continued)
branch = TreeBranch(Tree=simplify(series_2), Path=python_9.out, MaintainPaths=True)
item_3 = ListItem(List=geo_4, Index=branch, Wrap=True)

# ----
item_4 = ListItem(List=item_3, Index=series, Wrap=True)
filter = StreamFilter(Gate=list, Stream0=item_4, Stream1=item_3)
planetorobot_2 = Plane(flatten(filter))
# Robotic Fabrication
plane = Geometry(flatten(planetorobot_2))
fabrication = GhPythonScript(way_plane=plane, send=button)  # -> out, robot_planes, pick_up_planes, glue_plane, script; inputs way_plane: list
# ---------- fabrication: Python ----------
from compas_rhino import unload_modules
unload_modules('model')
from model import Brick

import Rhino.Geometry as rg
import simple_comm as c
import simple_ur_script as ur
import math as m


rhino_base_way_planes = way_plane

def tcp(script):
    """ This funktion sets tcp 
    """
    script += ur.set_tcp_by_angles(
        0.0, 0.0, 70, m.radians(0.0), m.radians(180.0), m.radians(0))
    return script


### set robot orint plane
def set_robot_base_plane_from_pts():

    pt_0 = rg.Point3d(299, 63, 0)  # base plane origin
    # point on base plane positive x direction
    pt_1 = rg.Point3d(499, 63, 0)
    pt_2 = rg.Point3d(499, 299, 0)  # point on base plane positive xy

    robot_base = rg.Plane(pt_0, pt_1-pt_0, pt_2-pt_0)
    return robot_base

def rhino_to_robot_space(rhino_plane):
    """ this funktion translates planes from the rhino cordinate system to
    the robot cordinate system 
    """
    robot_plane = rhino_plane.Clone()
    _r_matrix = rg.Transform.PlaneToPlane(rg.Plane.WorldXY, set_robot_base_plane_from_pts())
    robot_plane.Transform(_r_matrix)
    return robot_plane

def pickup_brick(pick_up_plane, script):
    """Pick up a brick procedure

    Parameters
    ----------
    pick_up_plane : rhino.geometry.plane
    
    Returns:
    Procedure for pickin up plane
    """
    accel = 0.3    # m/s2
    vel = 0.8      # m/s

    safe_distance = 50
    
    way_planes = []

    safe_plane = pick_up_plane.Clone()
    safe_plane.Translate(rg.Vector3d(0, 0, safe_distance))

    script += ur.move_l(safe_plane, accel, vel)
    way_planes.append(safe_plane)

    script += ur.move_l(pick_up_plane, accel, vel)
    way_planes.append(pick_up_plane)

    script += ur.set_digital_out(0, True)
    script += ur.sleep(1)

    script += ur.move_l(safe_plane, accel, vel)
    way_planes.append(safe_plane)

    return script 

def place_brick(plane, script):
    """
    this function gereates the robotic sequience for placing a brick
    Requires a plane wich describes the possition of the brick"""

    safe_distance = 50
    accel = 0.3
    vel = 0.3
    way_planes = []

    safe_plane = plane.Clone()
    safe_plane.Translate(rg.Vector3d(0, 0, safe_distance))

    script += ur.move_l(safe_plane, accel, vel)
    way_planes.append(safe_plane)

    script += ur.move_l(plane, accel, vel)
    way_planes.append(plane)

    script += ur.set_digital_out(0, False)
    script += ur.sleep(1)

    script += ur.move_l(safe_plane, accel, vel)
    way_planes.append(safe_plane)

    return script

def glue(plane, script):
    """
    this function gereates the robotic sequience for using_glue
    Requires a plane wich describes the possition of the brick"""

    safe_distance = 50
    accel = 0.5
    vel = 1
    
    way_planes = []

    safe_plane = plane.Clone()
    safe_plane.Translate(rg.Vector3d(0, 0, safe_distance))

    script += ur.move_l(safe_plane, accel, vel)
    way_planes.append(safe_plane)

    script += ur.move_l(plane, accel, vel)
    way_planes.append(plane)
    
    script += ur.move_l(safe_plane, accel, vel)
    way_planes.append(safe_plane)

    return script



""" Robotic fabrication procedure
"""
script = ""
script = tcp(script)

"""pick _up plane is measured in the robot base plane
"""
pick_up_planes =[]
for i in range(2):  # rows x-direction
    for j in range(12):  # rows y-direction
        for k in range(6):
            x_pos = k * (Brick.REFERENCE_LENGTH)
            y_pos = j * (Brick.REFERENCE_WIDTH)
            z_pos = i * (Brick.REFERENCE_HEIGHT)
            origin = rg.Point3d(-60+x_pos, 508-y_pos, 6.0+z_pos)
            pick_up_plane = rg.Plane(origin, rg.Vector3d.XAxis, rg.Vector3d.YAxis)
            pick_up_plane.Rotate(m.radians(-90), rg.Vector3d.ZAxis)
            pick_up_planes.append(pick_up_plane)
pick_up_planes.reverse()

robot_planes = []

"""We are translating all way_planes from rhino base to robot_base
"""
for rhino_plane in (rhino_base_way_planes):
    robot_planes.append(rhino_to_robot_space(rhino_plane))

glue_plane = rg.Plane(rg.Point3d(178.4, 466.2, 17.5), rg.Vector3d.XAxis, rg.Vector3d.YAxis)
glue_plane.Rotate(m.radians(-90), rg.Vector3d.ZAxis)


# set the start postion 
s_pos = [ m.radians(94.51),
   m.radians(-85.99),
   m.radians(-126.91),
   m.radians(-57.21),
   m.radians(90),
   m.radians(0)]
script += ur.move_j(s_pos, 0.4, 0.4)

for i in range(len(robot_planes)-1):
    #pick up a plane 
    if i< 21:
        script = pickup_brick(pick_up_planes[i], script)
        script = place_brick(robot_planes[i], script)
    else:
        script = pickup_brick(pick_up_planes[i], script)
        script = glue(glue_plane, script)
        script = place_brick(robot_planes[i], script)


#for robot_plane, pick_up_plane in zip(robot_planes, pick_up_planes):
#    #pick up a plane 
#    script = pickup_brick(pick_up_plane, script)
#    script = glue(glue_plane, script)
#    script = place_brick(robot_plane, script)


script = c.concatenate_script(script)

if send == True :
    c.send_script(script, "192.168.10.10")
# ---------- end fabrication ----------

# ---- group: Gule
number_slider_14 = Slider(75, range=0..1000)
dom = ConstructDomain(DomainStart=number_slider_14, DomainEnd=expr("x*-1", number_slider_14))
pt_2 = Point(fabrication.glue_plane)
rectangle = Rectangle(Plane=pt_2, XSize=dom, YSize=dom, Radius=0)  # -> Rectangle, Length

# ---- group: Brick
pln = Plane(fabrication.robot_planes)
preview_2 = CustomPreview(Geometry=python_6.bricks, Material=ColourSwatch(SwatchColor=RGBA(250, 111, 12, 101)))
points_2 = PointList(Points=pln, Size=Slider(1.22, range=0..10))

# ----
pln_2 = Plane(fabrication.pick_up_planes)
points_3 = PointList(Points=pln_2, Size=Slider(2, range=0..10))

panel_13 = Panel(fabrication.script)
plnaxis = PlaneAxis(P=fabrication.glue_plane, B=number_slider_11)
plnaxis_2 = PlaneAxis(P=fabrication.pick_up_planes, B=number_slider_11)

# ==== cluster PlaneAxis: show plane X Y Z axis.
P = ClusterInput()
B = ClusterInput()
deplane = DeconstructPlane(Plane=graft(P))  # -> Origin, XAxis, YAxis, ZAxis
multiplication = Multiplication(A=[deplane.XAxis, deplane.YAxis, deplane.ZAxis], B=B)
vdisex = VectorDisplayEx(
    Point=deplane.Origin,
    Vector=multiplication,
    Colour=[ColourSwatch(SwatchColor=RGB(235, 52, 52)), ColourSwatch(SwatchColor=RGB(90, 207, 48)), ColourSwatch(SwatchColor=RGB(54, 126, 227))],
    Width=2)
