# Grasshopper definition Herring_brick_fabrication_comb_plan.gh (Grasshopper 1.0.7)

final_herringbone_planes = Plane(Tree({0}: [Plane(origin=(25.8, 6, 8), x=(0, 1, 0), y=(-1, 0, 0)), Plane(origin=(42.3, 22.5, 8), x=(0, 1, 0), y=(-1, 0, 0)), Plane(origin=(58.8, 39, 8), x=(0, 1, 0), y=(-1, 0, 0)), Plane(origin=(75.3, 55.5, 8), x=(0, 1, 0), y=(-1, 0, 0)), Plane(origin=(91.8, 72, 8), x=(0, 1, 0), y=(-1, 0, 0)), PlaneXY(6, 12.5, 8)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], {1}: [Plane(origin=(25.03092486, 8.667121319, 16), x=(0.9945218954, 0.1045284633, 0), y=(-0.1045284633, 0.9945218954, 0)), Plane(origin=(39.71581649, 26.80145224, 16), x=(0.9945218954, 0.1045284633, 0), y=(-0.1045284633, 0.9945218954, 0)), Plane(origin=(54.40070812, 44.93578315, 16), x=(0.9945218954, 0.1045284633, 0), y=(-0.1045284633, 0.9945218954, 0)), Plane(origin=(69.08559975, 63.07011407, 16), x=(0.9945218954, 0.1045284633, 0), y=(-0.1045284633, 0.9945218954, 0)), Plane(origin=(4.65995632, 13.06185007, 16), x=(-0.1045284633, 0.9945218954, 0), y=(-0.9945218954, -0.1045284633, 0)), Plane(origin=(83.77049138, 81.20444499, 16), x=(0.9945218954, 0.1045284633, 0), y=(-0.1045284633, 0.9945218954, 0))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], {2}: [Plane(origin=(26.85456943, 5.12415152, 24), x=(0.02090075226, -0.9997815554, 0), y=(-0.9997815554, -0.02090075226, 0)), Plane(origin=(3.268524216, 13.48054955, 24), x=(0.9781476007, 0.2079116908, 0), y=(-0.2079116908, 0.9781476007, 0)), Plane(origin=(74.82284275, 89.51915487, 24), x=(-0.2079116908, 0.9781476007, 0), y=(-0.9781476007, -0.2079116908, 0)), Plane(origin=(15.97741673, 33.05052786, 24), x=(0.9781476007, 0.2079116908, 0), y=(-0.2079116908, 0.9781476007, 0)), Plane(origin=(28.68630924, 52.62050617, 24), x=(0.9781476007, 0.2079116908, 0), y=(-0.2079116908, 0.9781476007, 0)), Plane(origin=(41.39520176, 72.19048448, 24), x=(0.9781476007, 0.2079116908, 0), y=(-0.2079116908, 0.9781476007, 0))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], {3}: [Plane(origin=(22.68047799, 13.68818023, 32), x=(0.9510565163, 0.3090169944, 0), y=(-0.3090169944, 0.9510565163, 0)), Plane(origin=(33.27413011, 34.47939316, 32), x=(0.9510565163, 0.3090169944, 0), y=(-0.3090169944, 0.9510565163, 0)), Plane(origin=(1.840948508, 13.7515111, 32), x=(-0.3090169944, 0.9510565163, 0), y=(-0.9510565163, -0.3090169944, 0)), Plane(origin=(43.86778222, 55.27060608, 32), x=(0.9510565163, 0.3090169944, 0), y=(-0.3090169944, 0.9510565163, 0)), Plane(origin=(54.46143433, 76.06181901, 32), x=(0.9510565163, 0.3090169944, 0), y=(-0.3090169944, 0.9510565163, 0)), Plane(origin=(65.05508644, 96.85303193, 32), x=(0.9510565163, 0.3090169944, 0), y=(-0.3090169944, 0.9510565163, 0))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], {4}: [Plane(origin=(26.85456943, 5.12415152, 40), x=(0.02090075226, -0.9997815554, 0), y=(-0.9997815554, -0.02090075226, 0)), Plane(origin=(0.3928700156, 13.87176599, 40), x=(0.9135454576, 0.4067366431, 0), y=(-0.4067366431, 0.9135454576, 0)), Plane(origin=(8.755215456, 35.65642066, 40), x=(0.9135454576, 0.4067366431, 0), y=(-0.4067366431, 0.9135454576, 0)), Plane(origin=(54.57424002, 103.1257247, 40), x=(-0.4067366431, 0.9135454576, 0), y=(-0.9135454576, -0.4067366431, 0)), Plane(origin=(17.1175609, 57.44107532, 40), x=(0.9135454576, 0.4067366431, 0), y=(-0.4067366431, 0.9135454576, 0)), Plane(origin=(25.47990634, 79.22572998, 40), x=(0.9135454576, 0.4067366431, 0), y=(-0.4067366431, 0.9135454576, 0))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], {5}: [Plane(origin=(19.33745718, 18.11083158, 48), x=(0.8660254038, 0.5, 0), y=(-0.5, 0.8660254038, 0)), Plane(origin=(25.37687635, 40.65025074, 48), x=(0.8660254038, 0.5, 0), y=(-0.5, 0.8660254038, 0)), Plane(origin=(-1.059845811, 13.8399967, 48), x=(-0.5, 0.8660254038, 0), y=(-0.8660254038, -0.5, 0)), Plane(origin=(31.41629551, 63.1896699, 48), x=(0.8660254038, 0.5, 0), y=(-0.5, 0.8660254038, 0)), Plane(origin=(37.45571467, 85.72908906, 48), x=(0.8660254038, 0.5, 0), y=(-0.5, 0.8660254038, 0)), Plane(origin=(4.979573352, 36.37941586, 48), x=(-0.5, 0.8660254038, 0), y=(-0.8660254038, -0.5, 0))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]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))
final_herringbone_planes_forrobot = Plane(flatten(final_herringbone_planes))
branch = TreeBranch(Tree=final_herringbone_planes, Path=Slider(0, range=0..19), MaintainPaths=True)
