# Grasshopper definition populate_bricks_KO.ghx (Grasshopper 1.0.7)

crv = Curve(reparameterize(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))

divdist = DivideDistance(Curve=crv, Distance=Slider(50, range=0..100))  # -> Points, Tangents, Parameters
graph = GraphMapper(
    divdist.Parameters,
    x0=0,
    x1=1,
    y0=0,
    y1=1,
    container_name="Bezier",
    cpx=[0, 0.1085271314, 0.9085272551, 1],
    cpy=[0, 0.4688524604, 0.3934426308, 1])
eval = EvaluateCurve(Curve=crv, Parameter=graph)  # -> Point, Tangent, Angle
dist = Distance(PointA=graft(eval.Point), PointB=eval.Point)  # -> flatten(Distance)
mindist = GhPythonScript(x=dist)  # -> minDist; inputs x: list
# ---------- mindist: Python ----------
X = [i for i in x if i != 0]

minDist = min(X)

print(minDist)
# ---------- end mindist ----------
min_distance = Panel(mindist)

createareas = GhPythonScript(params=graph, starting_curve=crv, layers=Slider(1, range=0..10))  # -> out, curves, bboxes, mesh_bricks, pts_before_cluster; inputs params: list, starting_curve: Curve, layers: Int32
# ---------- createareas: Python ----------
import rhinoscriptsyntax as rs
import Rhino.Geometry as rg
import ghpythonlib.components as ghc
import random
random.seed(2)
from compas_rhino import unload_modules
unload_modules('model')

from model import Brick, Area

curve = starting_curve

areas_dict = {}

def areas_on_curve(crv, layer, width, params=params):
    layer_areas = []
    for i, _ in enumerate(params[:-1]):
        key = "L{}A{}".format(layer, i)
        area = Area(initial_curve=crv, start_param=params[i], end_param=params[i+1], layer=layer, area_index=i, width=width)
        areas_dict[key] = area
        layer_areas.append(area)
    return layer_areas
    
def move_curve_up(crv, height=Brick.REFERENCE_HEIGHT, trim_factor=0.05):
    V = rg.Vector3d.ZAxis * height
    crv.Translate(V)
    length = crv.GetLength()
    new_length = length * (1.0 - trim_factor)
    trim_length = (length - new_length) / 2
    _ , p0 = crv.LengthParameter(trim_length)
    _ , p1 = crv.LengthParameter(length - trim_length)
    trim = crv.Trim(rg.Interval(p0,p1))
    trim.Domain = rg.Interval(0.0, 1.0)
    return trim

def num_bricks(area):
    #calculate the area of a brick
    bl = Brick.REFERENCE_LENGTH
    bw = Brick.REFERENCE_WIDTH
    ba = bl * bw

    #calculate the are of a bounding_are
    b_crv = area
    b_mass_pro = rg.AreaMassProperties.Compute( b_crv )
    b_area = b_mass_pro.Area

    num_bricks = int ( b_area / (ba*1.5) )
    # print('ba : ', ba, 'b_area : ', b_area, 'num_bricks : ', num_bricks)
    return num_bricks

def populate_points(area, num_bricks):
    region = area
    pts = ghc.Populate2D(region=region, count=num_bricks, seed=random.randint(0,100))
    
    return pts

def random_brick_planes(points):
    planes = []
    
    for point in points:
        plane = rg.Plane(point, rg.Vector3d.ZAxis)
        
        start_vec = rg.Vector3d.XAxis
        end_vec = rg.Vector3d( random.random(), random.random(), 0)
        T = rg.Transform.Rotation( start_vec, end_vec, plane.Origin )
        plane.Transform(T)
        planes.append(plane)
    return planes



areas_list = []
max_width = 100
shorten_factor = 0.95

for i in range(layers):
    layer_areas = areas_on_curve(crv=curve, layer=i, width=max_width)
    
    areas_list.append(layer_areas)
    curve = move_curve_up(curve)
    max_width = max_width * shorten_factor


"""
To check and visualize parts
"""

#curves = []
#bboxes = []
#for areas in areas_list:
#    for a in areas:
#        curves.append(a.initial_curve)
#        bboxes.append(a.bounding_area())


array_curves = []
array_bboxes = []
array_mesh_bricks = []
array_pts_before_cluster = []

for areas in areas_list:
    curves = []
    bboxes = []
    mesh_bricks = []
    pts_before_cluster = []
    for area in areas:
        curves.append( area.initial_curve )
        bbox  = area.bounding_area()
        bboxes.append( bbox )
        num_brick = num_bricks(bbox)
        points = populate_points(bbox, num_brick)
        planes = random_brick_planes(points)
        for plane in planes:
            brick = Brick(plane)
            mesh_bricks.append( brick.mesh() )
            pt_before_cluster = brick.pts_before_clustering()
            for pt in pt_before_cluster:
                pts_before_cluster.append( pt )
    array_curves.append(curves)
    array_bboxes.append(bboxes)
    array_mesh_bricks.append(mesh_bricks)
    array_pts_before_cluster.append(pts_before_cluster)
# ---------- end createareas ----------
k_mean_clustering = CSharpScript(groupsNumber=Slider(50, range=0..250), precision="0.000001", seed=Slider(23, range=0..50))  # -> out, simplify(G); inputs points: tree of Point3d, groupsNumber: Int32, precision: Double, seed: Int32
# ---------- k_mean_clustering: C# ----------
    //Code by Dieter Toews
    //https://www.grasshopper3d.com/forum/topics/kmeans-1
    //Rewritten in January 2019 by Laurent Delrieu
    DataTree<Point3d> groupingsTree = new DataTree<Point3d>();
    for (int k_i = 0; k_i < points.BranchCount; k_i++)

    {List<Point3d> subpoints = points.Branch(k_i);
      Print(points.Path(k_i).ToString());
      //***************** Initialize K-Means Algorithm ****************************
      //Print("--------Initializing " + groupsNumber + " groupings-------");
      Component.Message = "K-Means Clustering";
      List<List<int>> groupings = new List<List<int>>();
      List<Point3d> oldCentroids = new  List<Point3d> ();
      List<Point3d> newCentroids = new  List<Point3d> ();
      for (int i = 0; i < groupsNumber; i++)
      {
        groupings.Add(new List<int>());
        newCentroids.Add(Point3d.Origin);
        oldCentroids.Add(Point3d.Origin);
        //Print("creating grouping " + i);
      }
      //randomly assign points from the input list (intialze the k-mean groups)
      //Print("--------Initializing group assignments (random)-------");
      Random r = new Random(seed);

      for (int j = 0 ; j < subpoints.Count; j++)
      {
        int groupNum = RandomNumber(r, groupsNumber - 1, 0);
        groupings[groupNum].Add(j);
        //Print("Adding index value " + groupings[groupNum][groupings[groupNum].Count - 1] + " to group " + groupNum + ".");
      }
      //***************** Do K-Means Algorithm ************************************
      //Print("--------Entering main k-means loop--------");
      bool isStillMoving = true;
      //Number of while counting
      int k = 0;
      double minDist, dist;
      Point3d XYZ = Point3d.Origin;
      Point3d pt = Point3d.Origin;

      while ( isStillMoving)
      {
        isStillMoving = false;
        //find new centroids
        //Print(".....finding new centroids");
        for (int i = 0; i < groupsNumber; i++)
        {
          oldCentroids[i] = newCentroids[i];
          for (int j = 0; j < groupings[i].Count; j++)
          {
            XYZ = XYZ + subpoints[groupings[i][j]];
          }
          XYZ = XYZ / ((double) groupings[i].Count + 1);

          Point3d newCentroid = XYZ;
          newCentroids[i] = newCentroid;
          //Print("New centroid for group " + i + " is " + newCentroids[i].ToString());
          groupings[i].Clear();
          dist = newCentroid.DistanceTo(oldCentroids[i]);

          if (dist > precision)
          {
            //Print("need to do more work");
            isStillMoving = true;
          }
        }
        //create new groupings

        //Print(".....creating new groupings");

        for (int j = 0; j < subpoints.Count; j++)
        {
          pt = subpoints[j];
          minDist = pt.DistanceTo(newCentroids[0]);
          int groupNum = 0;
          for (int i = 0; i < groupsNumber; i++)
          {
            dist = pt.DistanceTo(newCentroids[i]);
            if( minDist >= dist )
            {
              groupNum = i;
              minDist = dist;
            }
          }
          groupings[groupNum].Add(j);
          if ( isStillMoving == false)
          {
            groupingsTree.Add(pt, points.Path(k_i).AppendElement(groupNum));
          }
        }
        if (isStillMoving == false)
        {
          //Print("***************all groups setled exiting loop********************");
          //Print("***************total loop count is " + k + "************************");
        }
        //a hard limit on the number of loops to execute....
        if(k > 1000)
        {
          isStillMoving = false;
        }
        k += 1;
      }//End while
    }
    G = groupingsTree;
# ---------- k_mean_clustering: C# additional code ----------
  public int RandomNumber(Random r, int MaxNumber, int MinNumber)
  {
    //if passed incorrect arguments, swap them
    //can also throw exception or return 0
    if (MinNumber > MaxNumber)
    {
      int t = MinNumber;
      MinNumber = MaxNumber;
      MaxNumber = t;
    }
    return r.Next(MinNumber, MaxNumber);
  }
# ---------- end k_mean_clustering ----------

# ---- group: visualise clusters
hull = ConvexHull(Points=k_mean_clustering.G, Plane=PlaneXY(0, 0, 0))  # -> Hull, HullZ, Indices
crv_2 = Curve(hull.HullZ)
boundary = BoundarySurfaces(Edges=crv_2)
Z = UnitZ(Factor=1)
move = Move(Geometry=boundary, Motion=Z)  # -> Geometry, Transform
preview = CustomPreview(Geometry=move.Geometry, Material=ColourSwatch(SwatchColor=RGBA(255, 255, 255, 158)))

# ----
con = DelaunayEdges(Points=k_mean_clustering.G, Plane=PlaneXY(0, 0, 0))  # -> Connectivity, Edges
mesh = Mesh(createareas.mesh_bricks)
